# Grasshopper definition DemoStructuralDesignKit_Timber.gh (Grasshopper 1.0.8)

# ----
# Eurocodes EN 1995-1-1 Connection design example
number_slider = Slider(30, range=8..30)
bolt_t_s = CSharpScript(
    diameter=number_slider,
    fuk="390",
    timber="C24",
    t1=Slider(49, range=0..100),
    theta1=Slider(0, range=0..90),
    t_steel=Slider(6, range=0..10))  # -> out, capacity_total, failuremode, capacities_plane, failuremodes, spacings; inputs diameter: Double, fuk: Double, timber: String, t1: Double, theta1: Double, t_steel: Double
# ---------- bolt_t_s: C# ----------
// Grasshopper Script Instance
#region Usings
using System;
#r "C:\Users\Guillaume Caussarieu\source\repos\StructuralDesignKit_Timber\StructuralDesignKitLibrary\bin\Release\StructuralDesignKitLibrary.dll"
using System.Linq;
using System.Collections;
using System.Collections.Generic;
using System.Drawing;

using Rhino;
using Rhino.Geometry;

using Grasshopper;
using Grasshopper.Kernel;
using Grasshopper.Kernel.Data;
using Grasshopper.Kernel.Types;

using Conns = StructuralDesignKitLibrary.Connections;
using EC5 = StructuralDesignKitLibrary.EC5;
using Materials = StructuralDesignKitLibrary.Materials;

#endregion

public class Script_Instance : GH_ScriptInstance
{
    #region Notes
    /* 
      Members:
        RhinoDoc RhinoDocument
        GH_Document GrasshopperDocument
        IGH_Component Component
        int Iteration

      Methods (Virtual & overridable):
        Print(string text)
        Print(string format, params object[] args)
        Reflect(object obj)
        Reflect(object obj, string method_name)
    */
    #endregion

    private void RunScript(
		double diameter,
		double fuk,
		string timber,
		double t1,
		double theta1,
		double t_steel,
		ref object capacity_total,
		ref object failuremode,
		ref object capacities_plane,
		ref object failuremodes,
		ref object spacings)
    {
        // Write your logic here
        Conns.Interface.IFastener bolt = new Conns.Fasteners.FastenerBolt(diameter,fuk);
        Materials.MaterialTimberSoftwood wood = new Materials.MaterialTimberSoftwood(timber);
        var conn = new Conns.SteelTimberShear.SingleOuterSteelPlate(bolt,t_steel,theta1,wood,t1,true);
        capacity_total = conn.Capacity;
        capacities_plane = conn.Capacities;
        failuremode = conn.FailureMode;
        failuremodes = conn.FailureModes;

        bolt.ComputeSpacings(theta1,null);
        List<string> spacingData = new List<string>();
        spacingData.Add("a1min = " + conn.Fastener.a1min);
        spacingData.Add("a2min = " + conn.Fastener.a2min);
        spacingData.Add("a3tmin = " + conn.Fastener.a3tmin);
        spacingData.Add("a3cmin = " + conn.Fastener.a3cmin);
        spacingData.Add("a4tmin = " + conn.Fastener.a4tmin);
        spacingData.Add("a4cmin = " + conn.Fastener.a4cmin);
        spacings = spacingData;

    }
}
# ---------- end bolt_t_s ----------
bolt = CSharpScript(diameter=Slider(6, range=0..10), fuk="390")  # -> out, spacings; inputs diameter: Double, fuk: Double
# ---------- bolt: C# ----------
// Grasshopper Script Instance
#region Usings
using System;
#r "C:\Users\Guillaume Caussarieu\source\repos\StructuralDesignKit_Timber\StructuralDesignKitLibrary\bin\Release\StructuralDesignKitLibrary.dll"
using System.Linq;
using System.Collections;
using System.Collections.Generic;
using System.Drawing;

using Rhino;
using Rhino.Geometry;

using Grasshopper;
using Grasshopper.Kernel;
using Grasshopper.Kernel.Data;
using Grasshopper.Kernel.Types;

using Conns = StructuralDesignKitLibrary.Connections;
using EC5 = StructuralDesignKitLibrary.EC5;
using Materials = StructuralDesignKitLibrary.Materials;

#endregion

public class Script_Instance : GH_ScriptInstance
{
    #region Notes
    /* 
      Members:
        RhinoDoc RhinoDocument
        GH_Document GrasshopperDocument
        IGH_Component Component
        int Iteration

      Methods (Virtual & overridable):
        Print(string text)
        Print(string format, params object[] args)
        Reflect(object obj)
        Reflect(object obj, string method_name)
    */
    #endregion

    private void RunScript(double diameter, double fuk, ref object spacings)
    {
        // Write your logic here
        Conns.Interface.IFastener bolt = new Conns.Fasteners.FastenerBolt(diameter,fuk);

        bolt.ComputeSpacings(null,null);
        List<string> spacingData = new List<string>();
        spacingData.Add("a1min = " + bolt.a1min);
        spacingData.Add("a2min = " + bolt.a2min);
        spacingData.Add("a3tmin = " + bolt.a3tmin);
        spacingData.Add("a3cmin = " + bolt.a3cmin);
        spacingData.Add("a4tmin = " + bolt.a4tmin);
        spacingData.Add("a4cmin = " + bolt.a4cmin);
        spacings = spacingData;

    }
}
# ---------- end bolt ----------
panel = Panel(bolt_t_s.capacity_total)
panel_2 = Panel(bolt_t_s.failuremode)
panel_3 = Panel(bolt_t_s.capacities_plane)
varies_with_theta = Panel(bolt_t_s.spacings)
panel_4 = Panel(bolt.spacings)
panel_5 = Panel(bolt_t_s.failuremodes)

# ----
# Eurocodes EN 1995-1-1 Member design example
lateral_torsional_buckling_length_z = Panel("10")
buckling_length_y = Panel("3")
buckling_length_z = Panel("1.5")
service_class = Panel("1")
load_duration = Panel("Permanent")
n_kn = Panel("-100")
vy_kn = Panel("5")
vz_kn = Panel("5")
mx_kn_m = Panel("2")
my_kn_m = Panel("30")
mz_kn_m = Panel("15")
b = Slider(180, range=100..280)
h = Slider(460, range=100..1500)
merge = Merge(Data1=n_kn, Data2=vy_kn, Data3=vz_kn, Data4=mx_kn_m, Data5=my_kn_m, Data6=mz_kn_m)
merge_2 = Merge(Data1=buckling_length_y, Data2=buckling_length_z, Data3=lateral_torsional_buckling_length_z)
merge_3 = Merge(Data1=service_class, Data2=load_duration)
memberdesignec5 = CSharpScript(iForces=merge, iB=b, iH=h, iMat="GL24h", iGeometricalParam=merge_2, iDesignParam=merge_3)  # -> out, oTensionParallelToGrain, oCompressionParallelToGrain, oBending, oBendingAndTension, oBendindAndCompression, oBendingAndBuckling, oBendingAndLaterarTorsionalBuckling, oShear, oTorsion; inputs iForces: list of Double, iB: Int32, iH: Int32, iMat: String, iGeometricalParam: list of Double, iDesignParam: list
# ---------- memberdesignec5: C# ----------
// Grasshopper Script Instance
#region Usings
using System;
using System.Linq;
using System.Collections;
using System.Collections.Generic;
using System.Drawing;
#r "C:\Users\Guillaume Caussarieu\source\repos\StructuralDesignKit_Timber\StructuralDesignKitLibrary\bin\Release\StructuralDesignKitLibrary.dll"
using Rhino;
using Rhino.Geometry;

using Grasshopper;
using Grasshopper.Kernel;
using Grasshopper.Kernel.Data;
using Grasshopper.Kernel.Types;
using SDK_T = StructuralDesignKitLibrary;
using StructuralDesignKitLibrary.CrossSections;
using StructuralDesignKitLibrary.Materials;
using StructuralDesignKitLibrary.EC5;

#endregion

public class Script_Instance : GH_ScriptInstance
{
    #region Notes
    /* 
      Members:
        RhinoDoc RhinoDocument
        GH_Document GrasshopperDocument
        IGH_Component Component
        int Iteration

      Methods (Virtual & overridable):
        Print(string text)
        Print(string format, params object[] args)
        Reflect(object obj)
        Reflect(object obj, string method_name)
    */
    #endregion

    private void RunScript(
		List<double> iForces,
		int iB,
		int iH,
		string iMat,
		List<double> iGeometricalParam,
		List<object> iDesignParam,
		ref object oTensionParallelToGrain,
		ref object oCompressionParallelToGrain,
		ref object oBending,
		ref object oBendingAndTension,
		ref object oBendindAndCompression,
		ref object oBendingAndBuckling,
		ref object oBendingAndLaterarTorsionalBuckling,
		ref object oShear,
		ref object oTorsion)
    {


        //------------------------
        //Defining a cross section
        //------------------------

        //Defining the material using a helper function which transform a string to a material object used by the SDK_T
        IMaterialTimber Mat = GetTimberMaterialFromTag(iMat);

        //Defining the cross section
        CrossSectionRectangular CS = new CrossSectionRectangular(iB,iH,Mat);

        //------------------------
        //Mapping the forces to local variables for lisibility
        //------------------------
        double N = iForces[0];
        double Vy = iForces[1];
        double Vz = iForces[2];
        double Mx = iForces[3];
        double My = iForces[4];
        double Mz = iForces[5];

        //------------------------
        //Computing the stresses resulting from the forces on the defined cross section
        //------------------------

         double Sigma_N = CS.ComputeNormalStress(N);
         double TauY = CS.ComputeShearY(Vy);
         double TauZ = CS.ComputeShearY(Vz);
         double TauTorsion = CS.ComputeTorsion(Mx);
         double SigmaMy = CS.ComputeStressBendingY(My);
         double SigmaMz = CS.ComputeStressBendingZ(Mz);


        //------------------------
        //EN1995-1-1 member checks
        //------------------------

        //Translating the service class to a SKT_T object
        EC5_Utilities.ServiceClass SC = EC5_Utilities.GetServiceClass(Convert.ToInt32(iDesignParam[0]));

        //Translating the load duration to a SKT_T object
        EC5_Utilities.LoadDuration LD = EC5_Utilities.GetLoadDuration((string)iDesignParam[1]);

        //Defining Kmod
        double Kmod = EC5_Factors.Kmod(Mat.Type,SC,LD);

        //Defining Ym
        double Ym = 1.3;

        //Tension parallel to the grain
        if(N>0){
        double kh_tension = EC5_Factors.Kh_Tension(Mat.Type, iB, iH);
         oTensionParallelToGrain =  EC5_CrossSectionCheck.TensionParallelToGrain(Sigma_N,Mat,Kmod,Ym,kh_tension);
        }
        else oTensionParallelToGrain = 0;

        //Compression parallel to the grain
        if(N<0){
        
         oCompressionParallelToGrain =  EC5_CrossSectionCheck.CompressionParallelToGrain(Sigma_N,Mat,Kmod,Ym);
        }
        else oCompressionParallelToGrain = 0;

        //Bending
        double khBending_h = EC5_Factors.Kh_Bending(Mat.Type,CS.H);
        double khBending_b = EC5_Factors.Kh_Bending(Mat.Type,CS.B);
        oBending =  EC5_CrossSectionCheck.Bending(SigmaMy,SigmaMz,CS,Mat,Kmod,Ym,khBending_h,khBending_b);

        //Bending and tension
        if(N>0){
        double kh_tension = EC5_Factors.Kh_Tension(Mat.Type, iB, iH);
         oBendingAndTension =  EC5_CrossSectionCheck.BendingAndTension(SigmaMy,SigmaMz,Sigma_N,CS,Mat,Kmod, Ym, khBending_h, khBending_b);
        }
        else oBendingAndTension = 0;

        //Bending and compression & buckling
        if(N<0){
        
        double bucklingLengthY = iGeometricalParam[0];
        double bucklingLengthZ = iGeometricalParam[1];
            oBendindAndCompression =  EC5_CrossSectionCheck.BendingAndCompression(SigmaMy, SigmaMz,Sigma_N,CS,Mat,Kmod, Ym, khBending_h, khBending_b);
            oBendingAndBuckling = EC5_CrossSectionCheck.BendingAndBuckling(SigmaMy, SigmaMz,Sigma_N,bucklingLengthY, bucklingLengthZ,CS,Mat,Kmod, Ym, khBending_h, khBending_b);
        }
        else {
            oBendindAndCompression = 0;
            oBendingAndBuckling = 0;
        }

        //Bending and lateral torsional buckling
        double LTB_Length = iGeometricalParam[2];
        double bucklingLength_Y = iGeometricalParam[0];
        double bucklingLength_Z = iGeometricalParam[1];
        if(N>=0) Sigma_N = 0;
        oBendingAndLaterarTorsionalBuckling = EC5_CrossSectionCheck.LateralTorsionalBuckling(SigmaMy, SigmaMz,Sigma_N,bucklingLength_Y, bucklingLength_Z,LTB_Length,CS,Mat,Kmod, Ym, khBending_h, khBending_b);


        //Shear
        oShear = EC5_CrossSectionCheck.Shear(TauY,TauZ,Mat,Kmod,Ym);


        //Torsion
        oTorsion = EC5_CrossSectionCheck.Torsion(TauTorsion,TauY, TauZ, CS,Mat, Kmod, Ym);

    }
    //Helper functions

        /// <summary>
		/// Return a timber material object based on a string. Look into the database if t´his material exists. if not, an exception is thrown
		/// </summary>
		/// <param name="material"></param>
		/// <returns></returns>
		/// <exception cref="Exception"></exception>
		public static IMaterialTimber GetTimberMaterialFromTag(string material)
		{
			string ExceptionMaterialUnknown = string.Format("The material {0} is not part of the database, please define a correct material name or create a new material using the SDK.Material.Create function", material);

				//Lookup first letters to orient the search
				switch (material[0])
				{
					//Lookup if material is a defined Softwood
					case 'C':
						if (Enum.GetNames(typeof(MaterialTimberSoftwood.Grades)).Contains(material))
						{
							return new MaterialTimberSoftwood(material);
						}
						else throw new Exception(ExceptionMaterialUnknown);

					//Lookup if material is a defined Hardwood
					case 'D':
						if (Enum.GetNames(typeof(MaterialTimberHardwood.Grades)).Contains(material))
						{
							return new MaterialTimberHardwood(material);
						}
						else throw new Exception(ExceptionMaterialUnknown);


					//Lookup if material is a defined Glulam
					case 'G':
						if (Enum.GetNames(typeof(MaterialTimberGlulam.Grades)).Contains(material))
						{
							return new MaterialTimberGlulam(material);
						}
						else if (Enum.GetNames(typeof(MaterialTimberBaubuche.Grades)).Contains(material))
						{
							return new MaterialTimberBaubuche(material);
						}
						else throw new Exception(ExceptionMaterialUnknown);

					default:
						throw new Exception(ExceptionMaterialUnknown);
				}
		}

}
# ---------- end memberdesignec5 ----------

# ---- group: Design ratio
panel_6 = Panel(memberdesignec5.oTensionParallelToGrain)
panel_7 = Panel(memberdesignec5.oCompressionParallelToGrain)
panel_8 = Panel(memberdesignec5.oBending)
panel_9 = Panel(memberdesignec5.oBendingAndTension)
panel_10 = Panel(memberdesignec5.oBendindAndCompression)
panel_11 = Panel(memberdesignec5.oBendingAndBuckling)
panel_12 = Panel(memberdesignec5.oBendingAndLaterarTorsionalBuckling)
panel_13 = Panel(memberdesignec5.oShear)
panel_14 = Panel(memberdesignec5.oTorsion)
