# Grasshopper definition TestingDesignKitHolz.gh (Grasshopper 1.0.8)

bolt_t_s = CSharpScript(
    diameter=Slider(8, range=0..10),
    fuk="390",
    timber="C24",
    t1=Slider(50, range=0..100),
    theta1=Slider(90, range=0..90),
    t_steel=Slider(6, range=0..10))  # -> out, capacity_total, failuremode, capacities_plane, failuremodes, spacings; inputs diameter: Double, fuk: Double, timber: String, t1: Double, theta1: Double, t_steel: Double
# ---------- bolt_t_s: C# ----------
// Grasshopper Script Instance
#region Usings
using System;
#r "C:\Users\jjs\Documents\Github\StructuralDesignKit_Timber\GrasshopperDemo\StructuralDesignKitLibrary_FormatProposals.dll"
using System.Linq;
using System.Collections;
using System.Collections.Generic;
using System.Drawing;

using Rhino;
using Rhino.Geometry;

using Grasshopper;
using Grasshopper.Kernel;
using Grasshopper.Kernel.Data;
using Grasshopper.Kernel.Types;

using Conns = StructuralDesignKitLibrary.Connections;
using EC5 = StructuralDesignKitLibrary.EC5;
using Materials = StructuralDesignKitLibrary.Materials;

#endregion

public class Script_Instance : GH_ScriptInstance
{
    #region Notes
    /* 
      Members:
        RhinoDoc RhinoDocument
        GH_Document GrasshopperDocument
        IGH_Component Component
        int Iteration

      Methods (Virtual & overridable):
        Print(string text)
        Print(string format, params object[] args)
        Reflect(object obj)
        Reflect(object obj, string method_name)
    */
    #endregion

    private void RunScript(
		double diameter,
		double fuk,
		string timber,
		double t1,
		double theta1,
		double t_steel,
		ref object capacity_total,
		ref object failuremode,
		ref object capacities_plane,
		ref object failuremodes,
		ref object spacings)
    {
        // Write your logic here
        Conns.Interface.IFastener bolt = new Conns.Fasteners.FastenerBolt(diameter,fuk);
        Materials.MaterialTimberSoftwood wood = new Materials.MaterialTimberSoftwood(timber);
        var conn = new Conns.SteelTimberShear.SingleOuterSteelPlate(bolt,t_steel,theta1,wood,t1,true);
        capacity_total = conn.Capacity;
        capacities_plane = conn.Capacities;
        failuremode = conn.FailureMode;
        failuremodes = conn.FailureModes;

        bolt.ComputeSpacings(theta1,null);
        List<string> spacingData = new List<string>();
        spacingData.Add("a1min = " + conn.Fastener.a1min);
        spacingData.Add("a2min = " + conn.Fastener.a2min);
        spacingData.Add("a3tmin = " + conn.Fastener.a3tmin);
        spacingData.Add("a3cmin = " + conn.Fastener.a3cmin);
        spacingData.Add("a4tmin = " + conn.Fastener.a4tmin);
        spacingData.Add("a4cmin = " + conn.Fastener.a4cmin);
        spacings = spacingData;

    }
}
# ---------- end bolt_t_s ----------
bolt = CSharpScript(diameter=Slider(6, range=0..10), fuk="390")  # -> out, spacings; inputs diameter: Double, fuk: Double
# ---------- bolt: C# ----------
// Grasshopper Script Instance
#region Usings
using System;
#r "C:\Users\jjs\Documents\Github\StructuralDesignKit_Timber\GrasshopperDemo\StructuralDesignKitLibrary_FormatProposals.dll"
using System.Linq;
using System.Collections;
using System.Collections.Generic;
using System.Drawing;

using Rhino;
using Rhino.Geometry;

using Grasshopper;
using Grasshopper.Kernel;
using Grasshopper.Kernel.Data;
using Grasshopper.Kernel.Types;

using Conns = StructuralDesignKitLibrary.Connections;
using EC5 = StructuralDesignKitLibrary.EC5;
using Materials = StructuralDesignKitLibrary.Materials;

#endregion

public class Script_Instance : GH_ScriptInstance
{
    #region Notes
    /* 
      Members:
        RhinoDoc RhinoDocument
        GH_Document GrasshopperDocument
        IGH_Component Component
        int Iteration

      Methods (Virtual & overridable):
        Print(string text)
        Print(string format, params object[] args)
        Reflect(object obj)
        Reflect(object obj, string method_name)
    */
    #endregion

    private void RunScript(double diameter, double fuk, ref object spacings)
    {
        // Write your logic here
        Conns.Interface.IFastener bolt = new Conns.Fasteners.FastenerBolt(diameter,fuk);

        bolt.ComputeSpacings(null,null);
        List<string> spacingData = new List<string>();
        spacingData.Add("a1min = " + bolt.a1min);
        spacingData.Add("a2min = " + bolt.a2min);
        spacingData.Add("a3tmin = " + bolt.a3tmin);
        spacingData.Add("a3cmin = " + bolt.a3cmin);
        spacingData.Add("a4tmin = " + bolt.a4tmin);
        spacingData.Add("a4cmin = " + bolt.a4cmin);
        spacings = spacingData;

    }
}
# ---------- end bolt ----------
panel = Panel(bolt_t_s.capacity_total)
panel_2 = Panel(bolt_t_s.failuremode)
panel_3 = Panel(bolt_t_s.capacities_plane)
varies_with_theta = Panel(bolt_t_s.spacings)
panel_4 = Panel(bolt.spacings)
panel_5 = Panel(bolt_t_s.failuremodes)
